# Grasshopper definition ClusteringSimulationScript.gh (Grasshopper 1.0.7)
# plug-ins: Human, Kangaroo2 Components, Pufferfish, EleFront

# ----
# Run function!
button = Button()

# ----
# Author: Julian Riise
# Date: 20.04.2022
# 
# Goal: Generate an architecture plan from a pre-defined program og rooms.
# Plug-ins: Human (Preview line geometry), Kangaroo Physics (pulling engine)
# Center Geometry
# (Stationary yard)
crv = Curve([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])

# ----
# Input furniture geometry
_1 = Geometry([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])
_4 = Geometry([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])
_7 = Geometry([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])
_11 = Geometry([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])
_14 = Geometry([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])
_19 = Geometry([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])
_22 = Geometry([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])
_25 = Geometry([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])
_28 = Geometry([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])
_31 = Geometry(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)
_32 = Geometry([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])
_35 = Geometry([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])
_38 = Geometry([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])
_41 = Geometry([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])
_44 = Geometry([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])
_47 = Geometry([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])
_17 = Geometry([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])
_50 = Geometry([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])
_10 = Geometry(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)
_18 = Geometry(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)
_2 = Geometry([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])
_5 = Geometry([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])
_8 = Geometry([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])
_15 = Geometry([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])
_20 = Geometry([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])
_26 = Geometry([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])
_29 = Geometry([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])
_33 = Geometry([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])
_36 = Geometry([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])
_39 = Geometry([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])
_42 = Geometry([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])
_45 = Geometry([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])
_48 = Geometry([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])
_12 = Geometry([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])
_23 = Geometry([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])
_51 = Geometry(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)
_3 = Geometry([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])
_40 = Geometry(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)
_6 = Geometry([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])
_9 = Geometry([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])
_13 = Geometry([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])
_16 = Geometry([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])
_21 = Geometry([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])
_24 = Geometry([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])
_27 = Geometry([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])
_30 = Geometry([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])
_34 = Geometry([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])
_37 = Geometry([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])
_43 = Geometry([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])
_46 = Geometry([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])
_49 = Geometry([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])

mesh = Mesh(crv)

# ----
# Input Room outlines
stille = Geometry([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])
fritid = Geometry([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])
sammen = Geometry([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])
forme = Geometry([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])
utforske = Geometry([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])

preview = CustomPreview(Geometry=mesh, Material=ColourSwatch(SwatchColor=RGB(117, 28, 28)))
entwine = Entwine(Branch00=stille, Branch01=fritid, Branch02=sammen, Branch03=forme, Branch04=utforske, FlattenInputs=True)
entwine_2 = Entwine(
    Branch00=_41,
    Branch01=_42,
    Branch02=_43,
    Branch03=_44,
    Branch04=_45,
    Branch05=_46,
    Branch06=_47,
    Branch07=_48,
    Branch08=_49,
    Branch09=_50,
    Branch010=_51,
    FlattenInputs=True)
entwine_3 = Entwine(
    Branch00=_19,
    Branch01=_20,
    Branch02=_21,
    Branch03=_22,
    Branch04=_23,
    Branch05=_24,
    Branch06=_25,
    Branch07=_26,
    Branch08=_27,
    Branch09=_28,
    Branch010=_29,
    Branch011=_30,
    Branch012=_31,
    FlattenInputs=True)
entwine_4 = Entwine(
    Branch00=_1,
    Branch01=_2,
    Branch02=_3,
    Branch03=_4,
    Branch04=_5,
    Branch05=_6,
    Branch06=_7,
    Branch07=_8,
    Branch08=_9,
    Branch09=_10,
    FlattenInputs=True)
entwine_5 = Entwine(
    Branch00=_11,
    Branch01=_12,
    Branch02=_13,
    Branch03=_14,
    Branch04=_15,
    Branch05=_16,
    Branch06=_17,
    Branch07=_18,
    FlattenInputs=True)
entwine_6 = Entwine(
    Branch00=_32,
    Branch01=_33,
    Branch02=_34,
    Branch03=_35,
    Branch04=_36,
    Branch05=_37,
    Branch06=_38,
    Branch07=_39,
    Branch08=_40,
    FlattenInputs=True)
pcen = PolygonCenter(Polyline=entwine)  # -> CenterV, CenterE, CenterA
group = Group(Objects=entwine_4)  # -> flatten(Group)
group_2 = Group(Objects=entwine_5)  # -> flatten(Group)
group_3 = Group(Objects=entwine_3)  # -> flatten(Group)
group_4 = Group(Objects=entwine_6)  # -> flatten(Group)
group_5 = Group(Objects=entwine_2)  # -> flatten(Group)
avr = Average(Input=pcen.CenterV)
ln = Line(StartPoint=pcen.CenterV, EndPoint=avr)
inter = InterconnectPoints(Pts=flatten(avr))
length_line = LengthLine(Line=[ln, inter], Length=0, Strength=Slider(1, range=1..20, expression="x/1000"))
geo = Geometry(entwine)
previewlw = CustomPreviewLineweights(Geometry=[ln, pcen.CenterV, entwine], Shader=ColourSwatch(SwatchColor=RGB(214, 214, 214)), Absolute=False)
disc = Discontinuity(Curve=geo, Level=1)  # -> Points, Parameters

# ----
# Room names (in order)
panel = Panel("""BIBLIOTEK
LAGER
WC
GRUPPER
VOID
KLASSE
DATA
GRUPPE
WC
GARD
LAGER
LAGER
TEKNISK
SPORTSHALL
HC
GARDEROBE
GARDEROBE
GARD
KANTINE
LAGER
KJØKKEN
HC
WC
VOID
KONTOR
KONTOR
KONTOR
WC
GRUPPE
BORDTENNIS
VERKSTED
WC
LAGER
VOID
KLASSE
HC
LAGER
VERKSTED
GARD
LAB
LAGER
GRUPPE
LAB
GRUPPE
WC
VOID
WC
KLASSE
LAGER
GARD""")

crv_2 = Curve(geo)
avr_2 = Average(Input=disc.Points)
pln = Plane(flatten(entwine))
geo_2 = Geometry([group, group_2, group_3, group_4, group_5])
cc = CurveCollide(Curves=flatten(crv_2), PassiveCurves=crv, BasePlane=PlaneXY(0, 0, 0), Strength="1")  # -> Goal, Frames
show = Show(G=crv_2)
explode = Explode(Curve=crv_2, Recursive=True)  # -> Segments, Vertices
rigidpointset = RigidPointSet(Points=[disc.Points, avr_2], Strength=Slider(5, range=1..20, expression="x*2"))  # -> RigidBody, Planes
direction = Direction(Line=explode.Segments, Strength=Slider(5, range=1..20, expression="x*2"))
entwine_7 = Entwine(Branch00=show, Branch01=length_line, Branch02=[cc.Goal, rigidpointset.RigidBody, direction], FlattenInputs=True)
solver = Solver(GoalObjects=entwine_7, Reset=button, Threshold=1e-15, Tolerance=0.0001, On=Toggle(False))  # -> I, V, O
bang = ExplodeTree(Data=solver.O)  # -> Branch0, Branch1, Branch2
list = ValueList({"Point": 0, "Curve": 1, "Arc": 2, "Circle": 3, "Ellipse": 4, "Line": 5, "Polyline": 6, "Surface": 7, "Brep": 8, "Mesh": 9, "Polysurface": 10, "Block": 11, "Text": 12, "TextDot": 13, "Dimension": 14, "LinearDimension": 15, "AngularDimension": 16, "Hatch": 17, "Leader": 18}, selected="Curve")
unflatten = UnflattenTree(Tree=bang.Branch0, Guide=show)
filtertype = FilterByType(Geometry=flatten(bang.Branch2), ObjectType=list)
mesh_2 = Mesh(unflatten)
col = Colour([ColourSwatch(SwatchColor=RGB(0, 183, 255)), ColourSwatch(SwatchColor=RGB(255, 89, 0)), ColourSwatch(SwatchColor=RGB(0, 255, 38)), ColourSwatch(SwatchColor=RGB(0, 13, 255)), ColourSwatch(SwatchColor=RGB(255, 0, 238))])
null = NullItem(Item=filtertype)  # -> NullFlags, InvalidFlags, Description
preview_2 = CustomPreview(Geometry=mesh_2, Material=graft(col))
invbool = InvertBoolean(Boolean=null.InvalidFlags)  # -> Inverted, Number
cull = CullPattern(List=filtertype, CullPattern=invbool.Inverted)
crv_3 = Curve(cull)
pcen_2 = PolygonCenter(Polyline=crv_3)  # -> CenterV, CenterE, CenterA
pln_2 = Plane(crv_3)
previewlw_2 = CustomPreviewLineweights(Geometry=crv_3, Shader=ColourSwatch(SwatchColor=RGB(138, 138, 138)), Thickness=Slider(2, range=1..5), Absolute=False)
tag = TextTag(Location=pcen_2.CenterV, Text=panel, Colour=ColourSwatch(SwatchColor=RGB(107, 107, 107)))
orient = Orient(Geometry=flatten(geo_2), Source=pln, Target=pln_2)  # -> Geometry, Transform
previewlw_3 = CustomPreviewLineweights(
    Geometry=orient.Geometry,
    Shader=ColourSwatch(SwatchColor=RGB(184, 184, 184)),
    Thickness=Slider(1, range=1..5),
    Absolute=False)
